# Grasshopper definition KerfPatternsv2.gh (Grasshopper 1.0.7)
# plug-ins: LunchBox

pt = ConstructPoint(XCoordinate=Slider(42, range=0..100), YCoordinate=Slider(37, range=0..100), ZCoordinate=Slider(0, range=0..100))

# ---- group: tektites
a_crv = Curve([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])
b_crv = Curve([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])

# ----
pt_2 = Point(pt)

# ---- group: X and +
b_crv_2 = Curve(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)
a_crv_2 = Curve(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)

# ---- group: U Divisions
number_slider = Slider(30, range=0..100)

# ---- group: V Divisions
number_slider_2 = Slider(60, range=0..100)

# ---- group: Input Surface
srf = Surface(reparameterize(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))

# ----
number_slider_3 = Slider(10, range=0..10)
srf_2 = Surface(srf)

# ---- group: Kerf Style
list = ValueList({"Shape": 0, "Line": 1, "A + B": 2, "Attractor": 3}, selected="Attractor")

# ---- group: Kerf Line Controls
number_slider_4 = Slider(2.7, range=0..100)
number_slider_5 = Slider(0, range=0..360)

# ---- group: A + B Curves
b_crv_3 = Curve(b_crv_2)
a_crv_3 = Curve(a_crv_2)

# ---- group: Shape Controls / Shape Style
list_2 = ValueList({"Custom": 0, "Dogbone": 1, "Wave": 2, "Fillet Closed": 3, "X": 4, "Hollow \"X": 5, "Herringbone": 6, "Hollow Dogbone": 7}, selected="Dogbone")

# ---- group: Shape Controls / CUSTOM KERF CURVE
crv = Curve(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)

# ----
untrim = Untrim(Surface=srf)
series = Series(Start=Slider(5, range=0..10), Step=Slider(6, range=0..10), Count=Slider(7, range=0..100))

# ---- group: Shape Controls
kerf_angle = Slider(0, range=0..360)

# ---- group: Shape Controls / Scale Kerf
number_slider_6 = Slider(0.19, range=0..5)
number_slider_7 = Slider(0.16, range=0..5)

# ----
number_slider_8 = Slider(25, range=0..100)

# ---- group: Surface Grid
sdivide = DivideSurface(Surface=untrim, UCount=number_slider, VCount=number_slider_2)  # -> Points, Normals, Parameters

# ---- group: Generate Paths for Splitting
cluster = Cluster(A=number_slider, B=number_slider_2)

# ----
cir = Circle(Plane=PlaneXY(0, 0, 0), Radius=series)
lng = ListLength(List=cir)
series_2 = Series(Start=Slider(8, range=0..10), Step=Slider(16, range=0..20), Count=lng)
number_slider_9 = Slider(57, range=0..100)
cluster_2 = Cluster_4(G=list_2, _0=crv)

# ---- group: Split and Alternate for Interlaced Pattern
split = SplitTree(Data=sdivide.Points, Masks=flatten(cluster))  # -> Positive, Negative
dispatch = Dispatch(List=split.Negative, DispatchPattern=[True, False])  # -> ListA, graft(ListB)
dispatch_2 = Dispatch(List=split.Positive, DispatchPattern=[True, False])  # -> graft(ListA), ListB

# ----
vec2pt = Vector2Pt(PointA=pt_2, PointB=dispatch.ListB, Unitize=False)  # -> Vector, Length
vec2pt_2 = Vector2Pt(PointA=pt_2, PointB=dispatch_2.ListA, Unitize=False)  # -> Vector, Length
pl = PlaneNormal(Origin=dispatch_2.ListA, ZAxis=Vector(0, 0, 1))
pl_2 = PlaneNormal(Origin=dispatch.ListB, ZAxis=Vector(0, 0, 1))
align = AlignPlane(Plane=pl, Direction=vec2pt_2.Vector)  # -> Plane, Angle
align_2 = AlignPlane(Plane=pl_2, Direction=vec2pt.Vector)  # -> Plane, Angle
dispatch_3 = Dispatch(List=series_2, DispatchPattern=[True, False])  # -> ListA, ListB
dispatch_4 = Dispatch(List=cir, DispatchPattern=[True, False])  # -> ListA, ListB

# ---- group: Keep Out Region
debrep = DeconstructBrep(Brep=srf)  # -> Faces, Edges, Vertices
crv_2 = Curve(debrep.Edges)
join = JoinCurves(Curves=crv_2, Preserve=False)
offset = OffsetCurve(Curve=join, Distance=Slider(0, range=-5..5), Plane=PlaneXY(0, 0, 0), Corners=3)

# ----
scale_nu = ScaleNU(Geometry=cluster_2, Plane=PlaneXY(0, 0, 0), ScaleX=number_slider_6, ScaleY=number_slider_7, ScaleZ=1)  # -> Geometry, Transform
divide = DivideCurve(Curve=dispatch_4.ListB, Count=dispatch_3.ListB, Kinks=False)  # -> Points, Tangents, Parameters
divide_2 = DivideCurve(Curve=dispatch_4.ListA, Count=dispatch_3.ListA, Kinks=False)  # -> Points, Tangents, Parameters
hex = HexagonalStructure(Surface=srf_2, UDivisions=number_slider_8, VDivisions=number_slider_8, AdjustShape=0.3, Type=False)  # -> StructureLines, StructureNodes
dispatch_5 = Dispatch(List=divide_2.Points, DispatchPattern=[True, False])  # -> ListA, ListB
dispatch_6 = Dispatch(List=divide.Points, DispatchPattern=[True, False])  # -> ListA, ListB
dispatch_7 = Dispatch(List=divide_2.Tangents, DispatchPattern=[True, False])  # -> ListA, ListB
bbox = BoundingBox(Content=scale_nu.Geometry, Plane=PlaneXY(0, 0, 0), UnionBox=True)  # -> Box, Box_2
pt_3 = ConstructPoint(XCoordinate=0, YCoordinate=0, ZCoordinate=0)
dispatch_8 = Dispatch(List=divide.Tangents, DispatchPattern=[True, False])  # -> ListA, ListB
pt_4 = Point(dispatch_5.ListA)
pt_5 = Point(dispatch_6.ListB)
area = Area(Geometry=bbox.Box)  # -> Area, Centroid
curvepoint = PointOnCurve(hex.StructureLines, parameter=0.5)
dogbone_crv = Curve([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])
xy = XYPlane(Origin=pt_5)
xy_2 = XYPlane(Origin=pt_4)
vec2pt_3 = Vector2Pt(PointA=pt_5, PointB=pt_3, Unitize=False)  # -> Vector, Length
bbox_2 = BoundingBox(Content=dogbone_crv, Plane=PlaneXY(0, 0, 0), UnionBox=True)  # -> Box, Box_2
vec2pt_4 = Vector2Pt(PointA=pt_4, PointB=pt_3, Unitize=False)  # -> Vector, Length
align_3 = AlignPlane(Plane=xy, Direction=dispatch_8.ListB)  # -> Plane, Angle
scale = Scale(Geometry=hex.StructureLines, Center=curvepoint, Factor=Slider(0.7, range=0..1))  # -> Geometry, Transform
area_2 = Area(Geometry=bbox_2.Box)  # -> Area, Centroid
scale_nu_2 = ScaleNU(Geometry=dogbone_crv, Plane=area_2.Centroid, ScaleX=Slider(0.2, range=0..1), ScaleY=Slider(0.8, range=0..2), ScaleZ=1)  # -> Geometry, Transform
scale_2 = Scale(Geometry=dogbone_crv, Center=area_2.Centroid, Factor=Slider(0.5, range=0..1))  # -> Geometry, Transform
align_4 = AlignPlane(Plane=xy_2, Direction=dispatch_7.ListA)  # -> Plane, Angle
orient = Orient(Geometry=scale_nu.Geometry, Source=area.Centroid, Target=graft(align.Plane))  # -> Geometry, Transform
orient_2 = Orient(Geometry=scale_nu.Geometry, Source=area.Centroid, Target=graft(align_2.Plane))  # -> Geometry, Transform
a_b_curves = ABCurves(G_2=a_crv_3, B_2=dispatch_2.ListA, X=number_slider_6, Y=number_slider_7, D=kerf_angle, B=dispatch.ListB, G=b_crv_3)

# ---- group: Shape Generator
cluster_3 = Cluster_3(G=cluster_2, B_2=dispatch_2.ListA, X=number_slider_6, Y=number_slider_7, D=kerf_angle, B=dispatch.ListB)

# ---- group: Line Generator
cluster_4 = Cluster_2(A=number_slider_5, L=number_slider_4, d1=dispatch_2.ListA, d2=dispatch.ListB)

# ----
orient_3 = Orient(Geometry=scale_nu_2.Geometry, Source=area_2.Centroid, Target=graft(align_3.Plane))  # -> Geometry, Transform
orient_4 = Orient(Geometry=scale_nu_2.Geometry, Source=area_2.Centroid, Target=graft(align_4.Plane))  # -> Geometry, Transform
trim = TrimTree(Tree=orient.Geometry, Depth=1)
trim_2 = TrimTree(Tree=orient_2.Geometry, Depth=1)
xy_3 = XYPlane(Origin=Point(0, 0, 0))
crv_3 = Curve([trim, trim_2])
filter = StreamFilter(Gate=list, Stream0=cluster_3, Stream1=cluster_4, Stream2=a_b_curves, Stream3=crv_3)

# ---- group: CCX Trim
trim_3 = TrimWithRegion(Curve=graft(filter), Region=offset, Plane=xy_3)  # -> Inside, Outside

# ----
outside_curve = Curve(join)
kerf_curves = Curve(trim_3.Inside)

trim_4 = TrimWithRegion(Curve=graft(scale.Geometry), Region=offset, Plane=xy_3)  # -> Inside, Outside
crv_4 = Curve(trim_4.Inside)

# ==== cluster Cluster
A = ClusterInput()
B = ClusterInput()
max = Maximum(A=A, B=B)
dup = DuplicateData(Data=Slider(0, range=0..100), Number=max, Order=True)
series = Series(Start=0, Step=2, Count=max)
dup_2 = DuplicateData(Data=Slider(0, range=0..100), Number=max, Order=True)
merge = Merge(Data1=graft(dup_2), Data2=graft(dup), Data3=graft(series))
path = ConstructPath(Indices=merge)
B_2 = ClusterOutput(path)

# ==== cluster Cluster_2
d1 = ClusterInput()
d2 = ClusterInput()
merge = Merge(Data1=d1, Data2=d2)  # -> flatten(Result)
clean = CleanTree(RemoveNulls=True, RemoveInvalid=True, RemoveEmpty=False, Tree=merge)
vec = VectorXYZ(XComponent=1, YComponent=0, ZComponent=0)  # -> Vector, Length
rev = Reverse(Vector=vec.Vector)
Z = UnitZ(Factor=1)
merge_2 = Merge(Data1=vec.Vector, Data2=rev)
A = ClusterInput()
L = ClusterInput()
vrot = Rotate(Vector=merge_2, Axis=Z, Angle=degrees(A))
line = LineSDL(Start=graft(clean), Direction=vrot, Length=L)
join = JoinCurves(Curves=line, Preserve=False)  # -> flatten(Curves)
C = ClusterOutput(join)

# ==== cluster Cluster_3
G = ClusterInput()
D = ClusterInput()
Y = ClusterInput()
X = ClusterInput()
rad = Radians(Degrees=D)
scale_nu = ScaleNU(Geometry=G, Plane=PlaneXY(0, 0, 0), ScaleX=X, ScaleY=Y, ScaleZ=1)  # -> Geometry, Transform
bbox = BoundingBox(Content=scale_nu.Geometry, Plane=PlaneXY(0, 0, 0), UnionBox=True)  # -> Box, Box_2
area = Area(Geometry=bbox.Box)  # -> Area, Centroid
xy = XYPlane(Origin=area.Centroid)
rotate = Rotate(Geometry=scale_nu.Geometry, Angle=rad, Plane=xy)  # -> Geometry, Transform
B = ClusterInput()
B_2 = ClusterInput()
orient = Orient(Geometry=rotate.Geometry, Source=area.Centroid, Target=graft(B_2))  # -> Geometry, Transform
orient_2 = Orient(Geometry=rotate.Geometry, Source=area.Centroid, Target=graft(B))  # -> Geometry, Transform
trim = TrimTree(Tree=orient.Geometry, Depth=1)
trim_2 = TrimTree(Tree=orient_2.Geometry, Depth=1)
crv = Curve([trim, trim_2])
crv_2 = ClusterOutput(crv)

# ==== cluster Cluster_4
hollow_dogbone = Curve(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)
dogbone_crv = Curve([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])
_0 = ClusterInput()
herringbone = Curve([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])
G = ClusterInput()
fillet_closed = Curve(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)
hollow_x = Curve(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)
X = Curve([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])
wave_crv = Curve(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)
filter = StreamFilter(
    Gate=G,
    Stream0=_0,
    Stream1=dogbone_crv,
    Stream2=wave_crv,
    Stream3=fillet_closed,
    Stream4=X,
    Stream5=hollow_x,
    Stream6=herringbone,
    Stream7=hollow_dogbone)
s_1 = ClusterOutput(filter)

# ==== cluster ABCurves
G = ClusterInput()
G_2 = ClusterInput()
D = ClusterInput()
Y = ClusterInput()
X = ClusterInput()
rad = Radians(Degrees=D)
scale_nu = ScaleNU(Geometry=G, Plane=PlaneXY(0, 0, 0), ScaleX=X, ScaleY=Y, ScaleZ=1)  # -> Geometry, Transform
scale_nu_2 = ScaleNU(Geometry=G_2, Plane=PlaneXY(0, 0, 0), ScaleX=X, ScaleY=Y, ScaleZ=1)  # -> Geometry, Transform
bbox = BoundingBox(Content=scale_nu.Geometry, Plane=PlaneXY(0, 0, 0), UnionBox=True)  # -> Box, Box_2
bbox_2 = BoundingBox(Content=scale_nu_2.Geometry, Plane=PlaneXY(0, 0, 0), UnionBox=True)  # -> Box, Box_2
area = Area(Geometry=bbox.Box)  # -> Area, Centroid
area_2 = Area(Geometry=bbox_2.Box)  # -> Area, Centroid
xy = XYPlane(Origin=area.Centroid)
xy_2 = XYPlane(Origin=area_2.Centroid)
rotate = Rotate(Geometry=scale_nu.Geometry, Angle=rad, Plane=xy)  # -> Geometry, Transform
rotate_2 = Rotate(Geometry=scale_nu_2.Geometry, Angle=rad, Plane=xy_2)  # -> Geometry, Transform
B = ClusterInput()
B_2 = ClusterInput()
orient = Orient(Geometry=rotate_2.Geometry, Source=area_2.Centroid, Target=graft(B_2))  # -> Geometry, Transform
orient_2 = Orient(Geometry=rotate.Geometry, Source=area.Centroid, Target=graft(B))  # -> Geometry, Transform
trim = TrimTree(Tree=orient.Geometry, Depth=1)
trim_2 = TrimTree(Tree=orient_2.Geometry, Depth=1)
crv = Curve([trim, trim_2])
crv_2 = ClusterOutput(crv)
