# Grasshopper definition Segmented Bracelet Cluster.gh (Grasshopper 1.0.7)

bracelet_circumference = Slider(214.35, range=0..1000)
number_of_divisions = Slider(8, range=0..10)

# ---- group: Number of Hinge Knuckles
number_of_knuckles = Slider(5, range=0..10)

# ---- group: Height of "Thick" Layers
thick_layer_height = Slider(1.5, range=0..10)

# ----
wall_thickness = Slider(3, range=0..10)
overall_height = Slider(21, range=0..100)
cluster = Cluster(
    A_2=wall_thickness,
    B=wall_thickness,
    R=wall_thickness,
    A_3=bracelet_circumference,
    N_2=number_of_divisions,
    N=number_of_divisions,
    F_3=thick_layer_height,
    A=overall_height,
    B_2=number_of_knuckles,
    F=overall_height,
    C=number_of_knuckles,
    F_2=thick_layer_height,
    A_4=overall_height,
    A_5=thick_layer_height)
gate = StreamGate(Stream=cluster, Gate=Toggle(False))  # -> Target0, Target1
sunion = SolidUnion(Breps=gate.Target1)

# ==== cluster Cluster
N = ClusterInput()
B = ClusterInput()
N_2 = ClusterInput()
R = ClusterInput()
F = ClusterInput()
F_2 = ClusterInput()
A = ClusterInput()
B_2 = ClusterInput()
A_2 = ClusterInput()
F_3 = ClusterInput()
C = ClusterInput()
A_3 = ClusterInput()
A_4 = ClusterInput()
A_5 = ClusterInput()
pi = Pi(Factor="2")
division = Division(A=A_3, B=pi)
division_2 = Division(A=A_2, B=2)
subtraction = Subtraction(A=division, B=B)
multiplication = Multiplication(A=A_5, B="2")
division_3 = Division(A=A, B=B_2)
subtraction_2 = Subtraction(A=division, B=division_2)
series = Series(Start=0, Step=division_3, Count=C)
subtraction_3 = Subtraction(A=A_4, B=multiplication)
cir = Circle(Plane=PlaneXY(0, 0, 0), Radius=subtraction)
cir_2 = Circle(Plane=PlaneXY(0, 0, 0), Radius=subtraction_2)
cir_3 = Circle(Plane=PlaneXY(0, 0, 0), Radius=division)
Z = UnitZ(Factor=series)
divide = DivideCurve(Curve=cir, Count=N_2, Kinks=False)  # -> Points, Tangents, Parameters
divide_2 = DivideCurve(Curve=cir_3, Count=N, Kinks=False)  # -> Points, Tangents, Parameters
vec2pt = Vector2Pt(PointA=divide.Points, PointB=divide_2.Points, Unitize=False)  # -> Vector, Length
division_4 = Division(A=vec2pt.Vector, B="2")
move = Move(Geometry=divide.Points, Motion=division_4)  # -> Geometry, Transform
xy = XYPlane(Origin=move.Geometry)
align = AlignPlane(Plane=xy, Direction=division_4)  # -> Plane, Angle
cir_4 = Circle(Plane=align.Plane, Radius=expr("x/2", R))
cir_5 = Circle(Plane=align.Plane, Radius=0.5)
crvdom = CurveDomain(Curve=cir_4)  # -> Curve, Domain
move_2 = Move(Geometry=graft(cir_5), Motion=Z)  # -> Geometry, Transform
move_3 = Move(Geometry=graft(cir_4), Motion=Z)  # -> Geometry, Transform
ccx = CurveCurve(CurveA=cir_2, CurveB=cir_4)  # -> Points, ParamsA, ParamsB
dedomain = DeconstructDomain(Domain=crvdom.Domain)  # -> Start, expr("x/2", End)
Z_2 = UnitZ(Factor=division_3)
lng = ListLength(List=cir_4)
dup = DuplicateData(Data="0", Number=lng, Order=True)
merge = Merge(Data1=graft(move_2.Geometry), Data2=graft(move_3.Geometry))
extr = Extrude(Base=move_3.Geometry, Direction=Z_2)
extr_2 = Extrude(Base=move_2.Geometry, Direction=Z_2)
shatter = Shatter(Curve=reparameterize(cir_4), Parameters=[0, 0.5])
shatter_2 = Shatter(Curve=cir, Parameters=divide.Parameters)
shatter_3 = Shatter(Curve=cir_3, Parameters=divide_2.Parameters)
boundary = BoundarySurfaces(Edges=merge)
merge_2 = Merge(Data1=simplify(graft(dup)), Data2=simplify(ccx.ParamsB), Data3=simplify(graft(dedomain.End)))
dispatch = Dispatch(List=flatten(shatter), DispatchPattern=[True, False])  # -> ListA, ListB
merge_3 = Merge(Data1=graft(shatter_2), Data2=graft(shatter_3))
shift = ShiftList(List=dispatch.ListB, Shift=1, Wrap=True)
shatter_4 = Shatter(Curve=simplify(graft(cir_4)), Parameters=merge_2)
merge_4 = Merge(Data1=graft(extr_2), Data2=graft(extr), Data3=boundary)
merge_5 = Merge(Data1=simplify(graft(dispatch.ListA)), Data2=simplify(graft(shift)))
join = BrepJoin(Breps=merge_4)  # -> Breps, Closed
item = ListItem(List=shatter_4, Index=[0, 3], Wrap=True)
item_2 = ListItem(List=shatter_4, Index=[1, 2], Wrap=True)
edges = BrepEdges(Brep=join.Breps)  # -> Naked, Interior, NonManifold
ccx_2 = CurveCurve(CurveA=item, CurveB=cir_2)  # -> Points, ParamsA, ParamsB
merge_6 = Merge(Data1=simplify(merge_5), Data2=simplify(merge_3))
dispatch_2 = Dispatch(List=item_2, DispatchPattern=[True, False])  # -> flatten(ListA), flatten(ListB)
dispatch_3 = Dispatch(List=item, DispatchPattern=[True, False])  # -> flatten(ListA), flatten(ListB)
boundary_2 = BoundarySurfaces(Edges=edges.Naked)
Z_3 = UnitZ(Factor=F_2)
shift_2 = ShiftList(List=dispatch_2.ListB, Shift=1, Wrap=True)
shatter_5 = Shatter(Curve=cir_2, Parameters=flatten(ccx_2.ParamsB))
trim = TrimTree(Tree=boundary_2, Depth=1)
merge_7 = Merge(Data1=simplify(graft(dispatch_2.ListA)), Data2=simplify(graft(shift_2)))
dispatch_4 = Dispatch(List=shatter_5, DispatchPattern=[True, False])  # -> ListA, ListB
shift_3 = ShiftList(List=dispatch_3.ListB, Shift=1, Wrap=True)
merge_8 = Merge(Data1=trim, Data2=join.Breps)
move_4 = Move(Geometry=merge_6, Motion=Z_3)  # -> graft(Geometry), Transform
merge_9 = Merge(Data1=simplify(graft(dispatch_3.ListA)), Data2=simplify(graft(shift_3)))
crv = Curve(dispatch_4.ListA)
merge_10 = Merge(Data1=move_4.Geometry, Data2=graft(merge_6))
join_2 = BrepJoin(Breps=merge_8)  # -> Breps, Closed
loft = Loft(Curves=merge_10, Options={Adjust=False, Closed=False, LoftEnds=0, LoftSimp=0, LoftType=0, Rebuild=10, Refit=0.01})
merge_11 = Merge(Data1=merge_7, Data2=simplify(graft(shatter_2)), Data3=simplify(graft(crv)))
Z_4 = UnitZ(Factor=F_3)
Z_5 = UnitZ(Factor=subtraction_3)
Z_6 = UnitZ(Factor=F)
merge_12 = Merge(Data1=simplify(graft(crv)), Data2=simplify(graft(shatter_3)), Data3=merge_9)
boundary_3 = BoundarySurfaces(Edges=merge_6)
trim_2 = TrimTree(Tree=loft, Depth=1)
subtraction_4 = Subtraction(A=Z_6, B=Z_3)
boundary_4 = BoundarySurfaces(Edges=merge_11)
trim_3 = TrimTree(Tree=join_2.Breps, Depth=1)
move_5 = Move(Geometry=merge_12, Motion=Z_4)  # -> Geometry, Transform
move_6 = Move(Geometry=boundary_4, Motion=Z_4)  # -> Geometry, Transform
move_7 = Move(Geometry=trim_2, Motion=subtraction_4)  # -> Geometry, Transform
extr_3 = Extrude(Base=move_5.Geometry, Direction=Z_5)
move_8 = Move(Geometry=move_6.Geometry, Motion=Z_5)  # -> Geometry, Transform
move_9 = Move(Geometry=boundary_3, Motion=Z_6)  # -> Geometry, Transform
dispatch_5 = Dispatch(List=trim_3, DispatchPattern=[True, False])  # -> ListA, simplify(ListB)
join_3 = BrepJoin(Breps=[boundary_3, move_7.Geometry, trim_2, move_9.Geometry, move_6.Geometry, move_8.Geometry, extr_3])  # -> flatten(Breps), Closed
path_mapper = PathMapper(dispatch_5.ListB, source="{A,B}", target="{(path_index + 1) % path_count}")
shift_4 = ShiftList(List=join_3.Breps, Shift=-1, Wrap=True)
merge_13 = Merge(Data1=simplify(graft(shift_4)), Data2=simplify(dispatch_5.ListA), Data3=simplify(path_mapper))
R_2 = ClusterOutput(merge_13)
