# Grasshopper definition tweezer holder.gh (Grasshopper 1.0.7)

number_slider = Slider(10.5, range=0..100)
number_slider_2 = Slider(10, range=0..10)
addition = Addition(A=number_slider, B=Slider(2, range=0..10))
number_slider_3 = Slider(1, range=0..10)
series = Series(Start=number_slider, Step=addition, Count=number_slider_2)
series_2 = Series(Start=0, Step=addition, Count=number_slider_2)
pt = ConstructPoint(XCoordinate=series, YCoordinate=0, ZCoordinate=0)
pt_2 = ConstructPoint(XCoordinate=series_2, YCoordinate=Slider(7, range=0..10), ZCoordinate=0)
pt_3 = Point([pt_2, pt])
Z = UnitZ(Factor=Slider(10, range=0..10))
rec_2pt = Rectangle2Pt(Plane=PlaneXY(0, 0, 0), PointA=pt_2, PointB=pt, Radius=number_slider_3)  # -> Rectangle, Length
sort_pt = SortPoints(Points=pt_3)  # -> Points, Indices
debrep = DeconstructBrep(Brep=rec_2pt.Rectangle)  # -> Faces, Edges, Vertices
item = ListItem(List=sort_pt.Points, Index=[0, -1], Wrap=True)
move = Move(Geometry=rec_2pt.Rectangle, Motion=Z)  # -> Geometry, Transform
dispatch = Dispatch(List=item, DispatchPattern=[True, False])  # -> ListA, ListB
debrep_2 = DeconstructBrep(Brep=move.Geometry)  # -> Faces, Edges, Vertices
rec_2pt_2 = Rectangle2Pt(Plane=PlaneXY(0, 0, 0), PointA=dispatch.ListA, PointB=dispatch.ListB, Radius=number_slider_3)  # -> Rectangle, Length
item_2 = ListItem(List=debrep.Edges, Index=0, Wrap=True)  # -> Item1, Item, Item1_2
merge = Merge(Data1=graft(debrep.Edges), Data2=graft(debrep_2.Edges))
offset = OffsetCurve(Curve=rec_2pt_2.Rectangle, Distance=Slider(2, range=0..10), Corners=1)
join = JoinCurves(Curves=flatten([item_2.Item1, item_2.Item, item_2.Item1_2]), Preserve=False)
loft = Loft(Curves=merge, Options={Adjust=False, Closed=False, LoftEnds=0, LoftSimp=0, LoftType=0, Rebuild=10, Refit=0.01})
explode = Explode(Curve=offset, Recursive=True)  # -> Segments, Vertices
move_2 = Move(Geometry=offset, Motion=Z)  # -> Geometry, Transform
neg = Negative(Value=Slider(65, range=0..100))
Z_2 = UnitZ(Factor=neg)
item_3 = ListItem(List=explode.Segments, Index=0, Wrap=True)  # -> Item1, Item, Item1_2
boundary = BoundarySurfaces(Edges=flatten([move_2.Geometry, move.Geometry]))
move_3 = Move(Geometry=join, Motion=Z_2)  # -> Geometry, Transform
join_2 = JoinCurves(Curves=[item_3.Item1, item_3.Item, item_3.Item1_2], Preserve=False)
loft_2 = Loft(
    Curves=[move_2.Geometry, offset],
    Options={Adjust=False, Closed=False, LoftEnds=0, LoftSimp=0, LoftType=0, Rebuild=10, Refit=0.01})
connect = ConnectCurves(Curves=join, Continuity=0, Close=False, Bulge=1)
end = EndPoints(Curve=move_3.Geometry)  # -> Start, End
connect_2 = ConnectCurves(Curves=move_3.Geometry, Continuity=0, Close=False, Bulge=1)
end_2 = EndPoints(Curve=join_2)  # -> Start, End
pi = Pi(Factor=Slider(1, range=0..2))
ln = Line(StartPoint=end.Start, EndPoint=end.End)
end_3 = EndPoints(Curve=connect)  # -> Start, End
loft_3 = Loft(
    Curves=[connect, connect_2],
    Options={Adjust=False, Closed=False, LoftEnds=0, LoftSimp=0, LoftType=0, Rebuild=10, Refit=0.01})
ln_2 = Line(StartPoint=end_3.Start, EndPoint=end_2.Start)
ln_3 = Line(StartPoint=end_3.End, EndPoint=end_2.End)
revsrf = Revolution(Curve=move_3.Geometry, Axis=ln, Domain=pi)
join_3 = JoinCurves(Curves=[join_2, ln_3, ln_2], Preserve=False)
Z_3 = UnitZ(Factor=neg)
move_4 = Move(Geometry=join_2, Motion=Z_3)  # -> Geometry, Transform
extr = Extrude(Base=join_3, Direction=Z_3)
end_4 = EndPoints(Curve=move_4.Geometry)  # -> Start, End
ln_4 = Line(StartPoint=end_4.Start, EndPoint=end_4.End)
revsrf_2 = Revolution(Curve=move_4.Geometry, Axis=ln_4, Domain=pi)
join_4 = BrepJoin(Breps=flatten([loft, revsrf, boundary, loft_3, extr, revsrf_2, loft_2]))  # -> Breps, Closed
cap = CapHoles(Brep=join_4.Breps)
mesh = MeshBrep(
    Brep=cap,
    Settings={GridMaxCount=0, GridMinCount=16, JaggedSeams=False, MaxEdgeLength=0, MinEdgeLength=0.0001, MinTolerance=0, Refine=True, RefineAngle=0, RelativeTolerance=0.65, SimplePlanes=True, Tolerance=0})
